# Grasshopper definition Recursive_Panel_Subdivision.gh (Grasshopper 1.0.7)

srf = Surface(<surface referenced from the Rhino model>)
python = GhPythonScript(surface=srf, threshold=Slider(0.05, range=0..5))  # -> out, subSurfaces; inputs surface: Surface
# ---------- python: Python ----------
import Rhino

def Subdivide(_surface):
    #Create emptylist
    #Get the the U & V domain of the _surface as intervals
    u = Rhino.Geometry.Surface.Domain(_surface, 0)
    v = Rhino.Geometry.Surface.Domain(_surface, 1)
    
    #Get the domain edge values
    uMin = u.Min
    uMax = u.Max
    vMin = v.Min
    vMax = v.Max
    
    #Get the middle value of the domains
    uMid = (uMax+uMin)/2
    vMid = (vMax+vMin)/2
    
    #Create Division Intervals
    u0 = Rhino.Geometry.Interval(uMin, uMid)
    u1 = Rhino.Geometry.Interval(uMid, uMax)
    v0 = Rhino.Geometry.Interval(vMin, vMid)
    v1 = Rhino.Geometry.Interval(vMid, vMax)
    
    #Evaluate Tolerance
    p0 = Rhino.Geometry.Surface.PointAt(_surface, uMin, vMin)
    p1 = Rhino.Geometry.Surface.PointAt(_surface, uMax, vMax)
    
    pM0 = Rhino.Geometry.Surface.PointAt(_surface, uMid, vMid)
    pM1 = (p0 + p1) / 2
    
    dist = Rhino.Geometry.Point3d.DistanceTo(pM0, pM1)
    
    print dist
    
    if dist < threshold:
        listOfSurfaces.append(_surface)
    else:
        #Trim the _surface using the intervals (Surface division)
        s0 = Rhino.Geometry.Surface.Trim(_surface, u0, v0)
        s1 = Rhino.Geometry.Surface.Trim(_surface, u1, v0)
        s2 = Rhino.Geometry.Surface.Trim(_surface, u0, v1)
        s3 = Rhino.Geometry.Surface.Trim(_surface, u1, v1)
        
        
        #Subdivide again
        Subdivide(s0)
        Subdivide(s1)
        Subdivide(s2)
        Subdivide(s3)

#MAIN PROGRAM
listOfSurfaces = []
Subdivide(surface)

#OUTPUT
subSurfaces = listOfSurfaces
# ---------- end python ----------
python_2 = GhPythonScript(surface=srf)  # -> out, subSurfaces; inputs surface: Surface
# ---------- python_2: Python ----------
import Rhino

#Create emptylist
listOfSurfaces = []

#Get the the U & V domain of the surface as intervals
u = Rhino.Geometry.Surface.Domain(surface, 0)
v = Rhino.Geometry.Surface.Domain(surface, 1)

#Get the domain edge values
uMin = u.Min
uMax = u.Max
vMin = v.Min
vMax = v.Max

#Get the middle value of the domains
uMid = (uMax+uMin)/2
vMid = (vMax+vMin)/2

#Create Division Intervals
u0 = Rhino.Geometry.Interval(uMin, uMid)
u1 = Rhino.Geometry.Interval(uMid, uMax)
v0 = Rhino.Geometry.Interval(vMin, vMid)
v1 = Rhino.Geometry.Interval(vMid, vMax)

#Trim the surface using the intervals (Surface division)
s0 = Rhino.Geometry.Surface.Trim(surface, u0, v0)
s1 = Rhino.Geometry.Surface.Trim(surface, u1, v0)
s2 = Rhino.Geometry.Surface.Trim(surface, u0, v1)
s3 = Rhino.Geometry.Surface.Trim(surface, u1, v1)

#Add the splited surfaces into the list
listOfSurfaces.append(s0)
listOfSurfaces.append(s1)
listOfSurfaces.append(s2)
listOfSurfaces.append(s3)

#OUTPUT
subSurfaces = listOfSurfaces
# ---------- end python_2 ----------
python_3 = GhPythonScript(surface=srf)  # -> out, subSurfaces; inputs surface: Surface
# ---------- python_3: Python ----------
import Rhino

def Subdivide(_surface):
    #Create emptylist
    listOfSurfaces = []
    
    #Get the the U & V domain of the _surface as intervals
    u = Rhino.Geometry.Surface.Domain(_surface, 0)
    v = Rhino.Geometry.Surface.Domain(_surface, 1)
    
    #Get the domain edge values
    uMin = u.Min
    uMax = u.Max
    vMin = v.Min
    vMax = v.Max
    
    #Get the middle value of the domains
    uMid = (uMax+uMin)/2
    vMid = (vMax+vMin)/2
    
    #Create Division Intervals
    u0 = Rhino.Geometry.Interval(uMin, uMid)
    u1 = Rhino.Geometry.Interval(uMid, uMax)
    v0 = Rhino.Geometry.Interval(vMin, vMid)
    v1 = Rhino.Geometry.Interval(vMid, vMax)
    
    #Trim the _surface using the intervals (Surface division)
    s0 = Rhino.Geometry.Surface.Trim(_surface, u0, v0)
    s1 = Rhino.Geometry.Surface.Trim(_surface, u1, v0)
    s2 = Rhino.Geometry.Surface.Trim(_surface, u0, v1)
    s3 = Rhino.Geometry.Surface.Trim(_surface, u1, v1)
    
    #Add the splited _surfaces into the list
    listOfSurfaces.append(s0)
    listOfSurfaces.append(s1)
    listOfSurfaces.append(s2)
    listOfSurfaces.append(s3)
    
    return listOfSurfaces

#OUTPUT
subSurfaces = Subdivide(surface)
# ---------- end python_3 ----------
mesh_uv = MeshSurface(Surface=python.subSurfaces, UCount="1", VCount="1", Overhang=True, Equalize=False)
